# Dynamo graph room boundaries.dyn (Dynamo 1.1.0.2094)

addItemToEnd = List.AddItemToEnd()
map = List.Map(f_x=addItemToEnd)
categories = Categories("Rooms")
all_elements_of_category = ElementsOfCategory(categories)
boundaries = Custom[Room.Boundaries](room=all_elements_of_category)  # Gets a list of all boundary elements of a given room or area
startPoint = Curve.StartPoint(boundaries.curves)
X = Point.X(startPoint)
Y = Point.Y(startPoint)
endPoint = Curve.EndPoint(boundaries.curves)
X_2 = Point.X(endPoint)
Y_2 = Point.Y(endPoint)
length = Curve.Length(boundaries.curves)
create = List.Create(X, Y, X_2, Y_2, length)
transpose = List.Transpose(create)
transpose_2 = List.Transpose(transpose)
string = StringInput("Department")
getParameterValueByName = Element.GetParameterValueByName(element=all_elements_of_category, parameterName=string)
string_2 = StringInput("Name")
getParameterValueByName_2 = Element.GetParameterValueByName(element=all_elements_of_category, parameterName=string_2)
combine = List.Combine(map, transpose_2, getParameterValueByName, getParameterValueByName_2)
flatten = Flatten()
map_2 = List.Map(f_x=flatten)
map_3 = List.Map(list=combine, f_x=map_2)
number = DoubleInput(1)
flatten_2 = List.Flatten(list=map_3, amt=number)
file_path = Filename(".\rmbd")
writeToFile = CSV.WriteToFile(file_path, transpose_2)
