# Dynamo graph unit data.dyn (Dynamo 1.1.0.2094)

file_path = Filename(".\unit%20types")
string = StringInput("Name")
categories = Categories("Areas")
all_elements_of_category = ElementsOfCategory(categories)
string_2 = StringInput("Name")
getParameterValueByName = Element.GetParameterValueByName(element=all_elements_of_category, parameterName=string_2)
addItemToFront = List.AddItemToFront(item=string, list=getParameterValueByName)
string_3 = StringInput("Area")
string_4 = StringInput("Area")
getParameterValueByName_2 = Element.GetParameterValueByName(element=all_elements_of_category, parameterName=string_4)
addItemToFront_2 = List.AddItemToFront(item=string_3, list=getParameterValueByName_2)
string_5 = StringInput("Perimeter")
string_6 = StringInput("Perimeter")
getParameterValueByName_3 = Element.GetParameterValueByName(element=all_elements_of_category, parameterName=string_6)
addItemToFront_3 = List.AddItemToFront(item=string_5, list=getParameterValueByName_3)
string_7 = StringInput("Centroid X")
location = Custom[Element.Location](element=all_elements_of_category)  # Returns the location of an element as an XYZ (or if it's line-based the start and end point of the line), along with some booleans to help filtering the results. Use this for some element types (e.g. walls or lines) that do not work with the built-in Get Family Instance Location node.
flatten = Flatten(location.points)
X = Point.X(flatten)
addItemToFront_4 = List.AddItemToFront(item=string_7, list=X)
string_8 = StringInput("Centroid Y")
Y = Point.Y(flatten)
addItemToFront_5 = List.AddItemToFront(item=string_8, list=Y)
create = List.Create(addItemToFront, addItemToFront_2, addItemToFront_3, addItemToFront_4, addItemToFront_5)
transpose = List.Transpose(create)
writeToFile = CSV.WriteToFile(file_path, transpose)
