# Dynamo graph wall data.dyn (Dynamo 1.1.0.2094)

file_path = Filename(".\wall%20data")
string = StringInput("Unit Type")
categories = Categories("Rooms")
all_elements_of_category = ElementsOfCategory(categories)
string_2 = StringInput("Department")
getParameterValueByName = Element.GetParameterValueByName(element=all_elements_of_category, parameterName=string_2)
addItemToFront = List.AddItemToFront(item=string, list=getParameterValueByName)
string_3 = StringInput("Name")
string_4 = StringInput("Name")
getParameterValueByName_2 = Element.GetParameterValueByName(element=all_elements_of_category, parameterName=string_4)
addItemToFront_2 = List.AddItemToFront(item=string_3, list=getParameterValueByName_2)
string_5 = StringInput("Area")
string_6 = StringInput("Area")
getParameterValueByName_3 = Element.GetParameterValueByName(element=all_elements_of_category, parameterName=string_6)
addItemToFront_3 = List.AddItemToFront(item=string_5, list=getParameterValueByName_3)
string_7 = StringInput("Perimeter")
string_8 = StringInput("Perimeter")
getParameterValueByName_4 = Element.GetParameterValueByName(element=all_elements_of_category, parameterName=string_8)
addItemToFront_4 = List.AddItemToFront(item=string_7, list=getParameterValueByName_4)
string_9 = StringInput("Centroid X")
geometry = Element.Geometry(all_elements_of_category)
centroid = Solid.Centroid(geometry)
flatten = Flatten(centroid)
X = Point.X(flatten)
addItemToFront_5 = List.AddItemToFront(item=string_9, list=X)
string_10 = StringInput("Centroid Y")
Y = Point.Y(flatten)
addItemToFront_6 = List.AddItemToFront(item=string_10, list=Y)
create = List.Create(addItemToFront, addItemToFront_2, addItemToFront_3, addItemToFront_4, addItemToFront_5, addItemToFront_6)
transpose = List.Transpose(create)
writeToFile = CSV.WriteToFile(file_path, transpose)
